# Grasshopper definition extrinsic_mocap_calibration_single_arm.ghx (Grasshopper 1.0.8)
# plug-ins: Human, MetaHopper

# ---- group: dual-arm husky
# Dual-arm Husky
panel = Panel("C:\Users\SU\Documents\GitHub\husky-assembly-teleop\data\husky_urdf")
panel_2 = Panel("D:\0_Project\03-2025_husky_assembly\Code\husky-assembly-teleop\data\husky_urdf")
panel_3 = Panel("husky_dual_ur5_e_no_base_joint.urdf")
boolean_toggle = BooleanToggle(True)
load_robot = Button()
python_3_script = Python3Script(
    load=load_robot,
    pkg_path=panel,
    pkg_name="mt_husky_dual_ur5_e_moveit_config",
    urdf_file="husky_dual_ur5_e_no_base_joint_All_Calibrated.urdf",
    srdf_file="dual_arm_husky.srdf")  # -> out, robot_model, robot_semantics
# ---------- python_3_script: Python ----------
from scriptcontext import sticky as st
import os
import compas

from compas_robots import RobotModel
from compas_robots.resources import GithubPackageMeshLoader
from compas_robots.resources import LocalPackageMeshLoader
from compas_robots.ghpython.scene import RobotModelObject
# from compas_fab.robots import Robot
from compas_fab.robots import RobotSemantics
# from compas_ghpython.artists import RobotModelArtist

# Robot meshes are usually in meters
# Set a high percision to prevent parsing errors
# and configure Rhino itself in meters
compas.PRECISION = '12f'

# Store robot in component-based key
# ghenv.Component.InstanceGuid
robot_key = 'robot_{}'.format(str('dual-arm_husky_Cindy'))

if robot_key not in st:
    st[robot_key] = None

loader = LocalPackageMeshLoader(os.path.join(pkg_path), pkg_name)

if load:
# if True:
    # Also load geometry
    husky_loader = LocalPackageMeshLoader(os.path.join(pkg_path), "husky_description")
    dualarm_husky_loader = LocalPackageMeshLoader(os.path.join(pkg_path), "husky_ur_description")
    ur_loader = LocalPackageMeshLoader(os.path.join(pkg_path), "ur_description")
    
    # Create robot model from URDF
    model = RobotModel.from_urdf_string(loader.load_urdf(urdf_file).read())
    model.load_geometry(loader, husky_loader, dualarm_husky_loader, ur_loader)
    print(model)

    # # artist = RobotModelArtist(model)
    # scene_object = RobotModelObject(item=model)

    # # robot = Robot(model)
    # robot = Robot(model, scene_object, semantics=robot_semantics)
##    robot.scale(1000)
    st[robot_key] = model

robot_model = st[robot_key]
robot_semantics = None
if srdf_file:
    robot_semantics = RobotSemantics.from_srdf_file(loader.build_path('config', srdf_file), robot_model)


#repo    = 'ros-industrial/abb'
#package = 'abb_irb6600_support'
#branch  = 'kinetic-devel'
#
#github = GithubPackageMeshLoader(repo, package, branch)
#
#model = RobotModel.from_urdf_file(github.load_urdf('irb6640.urdf'))
#model.load_geometry(github)
#artist = RobotModelArtist(model)
#robot = Robot(model, artist)
# ---------- end python_3_script ----------

# ----
brep = Brep(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)
mesh_brep = MeshBrep(
    Brep=brep,
    Settings={GridMaxCount=0, GridMinCount=16, JaggedSeams=False, MaxEdgeLength=0, MinEdgeLength=0.0001, MinTolerance=0, Refine=True, RefineAngle=0, RelativeTolerance=0.65, SimplePlanes=True, Tolerance=0})
xy_plane = XYPlane(Origin=Point(0, 0, 0))
triangulate = Triangulate(Mesh=mesh_brep)  # -> Mesh, Count
python_3_script_2 = Python3Script(name="MocapEE", tool_visual_meshes=triangulate.Mesh, tool_collision_meshes=triangulate.Mesh, tool_frame=xy_plane)  # -> out, tool_model; inputs tool_visual_meshes: list of Mesh, tool_collision_meshes: list of Mesh, tool_frame: Plane
# ---------- python_3_script_2: Python ----------
from compas_robots import ToolModel
from compas.geometry import Transformation
from compas_rhino.conversions import plane_to_compas_frame, mesh_to_compas

cp_visual_meshes = [mesh_to_compas(vm) for vm in tool_visual_meshes]
cp_collision_meshes = [mesh_to_compas(vm) for vm in tool_collision_meshes]
cp_tool_frame = plane_to_compas_frame(tool_frame)

tool_model = ToolModel(None, cp_tool_frame, None, name)

tool_model.add_link("attached_tool_link", visual_meshes=cp_visual_meshes, collision_meshes=cp_collision_meshes)
tool_model._rebuild_tree()
tool_model._create(tool_model.root, Transformation())
# ---------- end python_3_script_2 ----------

# ---- group: single-arm husky
# Single-arm Husky
panel_4 = Panel("husky_ur5_e_no_base_joint_Alice_Calibrated.urdf")
load_robot_2 = Button()
python_3_script_3 = Python3Script(load=load_robot_2, pkg_path=panel, pkg_name="mt_husky_moveit_config", urdf_file=panel_4, srdf_file="husky.srdf")  # -> out, robot_model, robot_semantics
# ---------- python_3_script_3: Python ----------
from scriptcontext import sticky as st
import os
import compas

from compas_robots import RobotModel
from compas_robots.resources import GithubPackageMeshLoader
from compas_robots.resources import LocalPackageMeshLoader
from compas_robots.ghpython.scene import RobotModelObject
# from compas_fab.robots import Robot
from compas_fab.robots import RobotSemantics
# from compas_ghpython.artists import RobotModelArtist

# Robot meshes are usually in meters
# Set a high percision to prevent parsing errors
# and configure Rhino itself in meters
compas.PRECISION = '12f'

# Store robot in component-based key
# ghenv.Component.InstanceGuid
robot_key = 'robot_{}'.format(str('single-arm_husky_Alice'))

if robot_key not in st:
    st[robot_key] = None

loader = LocalPackageMeshLoader(os.path.join(pkg_path), pkg_name)

if load:
# if True:
    # Also load geometry
    husky_loader = LocalPackageMeshLoader(os.path.join(pkg_path), "husky_description")
    dualarm_husky_loader = LocalPackageMeshLoader(os.path.join(pkg_path), "husky_ur_description")
    ur_loader = LocalPackageMeshLoader(os.path.join(pkg_path), "ur_description")
    
    # Create robot model from URDF
    model = RobotModel.from_urdf_string(loader.load_urdf(urdf_file).read())
    model.load_geometry(loader, husky_loader, dualarm_husky_loader, ur_loader)
    print(model)

    # # artist = RobotModelArtist(model)
    # scene_object = RobotModelObject(item=model)

    # # robot = Robot(model)
    # robot = Robot(model, scene_object, semantics=robot_semantics)
##    robot.scale(1000)
    st[robot_key] = model

robot_model = st[robot_key]
robot_semantics = None
if srdf_file:
    robot_semantics = RobotSemantics.from_srdf_file(loader.build_path('config', srdf_file), robot_model)


#repo    = 'ros-industrial/abb'
#package = 'abb_irb6600_support'
#branch  = 'kinetic-devel'
#
#github = GithubPackageMeshLoader(repo, package, branch)
#
#model = RobotModel.from_urdf_file(github.load_urdf('irb6640.urdf'))
#model.load_geometry(github)
#artist = RobotModelArtist(model)
#robot = Robot(model, artist)
# ---------- end python_3_script_3 ----------

# ----
# 1. Initial setting
# note: check python component if switch into diff robot
manipulation_model = ValueList({"single-arm": "manipulator", "left-arm": "base_left_arm_manipulator", "right-arm": "base_right_arm_manipulator"}, selected="right-arm")  # disabled
panel_5 = Panel("""manipulator
base_left_arm_manipulator
base_right_arm_manipulator""")
manipulation_model_2 = ValueList({"single-arm": 0, "left-arm": 1, "right-arm": 2}, selected="single-arm")
robot_id = ValueList({"Alice 0804": "0804", "Belle 0805": "0805", "Cindy 0806": "0806"}, selected="Alice 0804")
list_item = ListItem(List=panel_5, Index=manipulation_model_2, Wrap=True)

# ---- group: single arm
python_3_script_4 = Python3Script(
    robot_model=python_3_script_3.robot_model,
    robot_semantics=python_3_script_3.robot_semantics,
    tool=python_3_script_2.tool_model)  # -> out, robot_cell, robot_cell_state; inputs rigid_bodies: list, object_frame: Plane
# ---------- python_3_script_4: Python ----------
#aasss venv: compas_fab_dev

from compas_fab.robots import RobotCell
from compas_fab.robots import RobotCellState
from compas_fab.robots import RigidBodyState
from compas.geometry import Box
from compas.geometry import Frame
from compas_rhino.conversions import plane_to_compas_frame

from compas_fab.robots import RobotCellLibrary
from compas_robots import ToolModel

robot_cell = RobotCell(robot_model, robot_semantics)

# robot_cell.tool_models['Alice'] = ToolModel.from_robot_model(support_robot_model.copy(), Frame.worldXY())
# robot_cell.tool_models['Belle'] = ToolModel.from_robot_model(support_robot_model.copy(), Frame.worldXY())

# robot_cell.tool_models['AL'] = assembly_tool.copy()
# robot_cell.tool_models['AR'] = assembly_tool.copy()

#################
if tool:
    robot_cell.tool_models['MocapEE'] = tool.copy()

#################
robot_cell_state = robot_cell.default_cell_state()

if tool:
    robot_cell_state.tool_states['MocapEE'].attached_to_group = 'manipulator'
    robot_cell_state.tool_states['MocapEE'].touch_links = ['ur_arm_wrist_3_link']

# if (rigid_bodies):
#     # Make sure RBs have unique names
#     assert len(set([rb.name for rb in rigid_bodies])) == len(rigid_bodies)
#     for rb in rigid_bodies:
#         assert rb.name
#         robot_cell.rigid_body_models[rb.name] = rb
#         robot_cell_state.rigid_body_states[rb.name] = RigidBodyState(
#             plane_to_compas_frame(object_frame),
#             is_hidden=is_hidden,
#         )

from compas.scene import Scene
scene = Scene()
scene.add(robot_cell)
# ---------- end python_3_script_4 ----------

# ----
dual_arm = Python3Script(
    robot_model=python_3_script_3.robot_model,
    robot_semantics=python_3_script_3.robot_semantics,
    point_tool=python_3_script_2.tool_model,
    board_tool=python_3_script_2.tool_model)  # -> out, robot_cell, robot_cell_state; inputs rigid_bodies: list, object_frame: Plane
# ---------- dual_arm: Python ----------
#aasss venv: compas_fab_dev

from compas_fab.robots import RobotCell
from compas_fab.robots import RobotCellState
from compas_fab.robots import RigidBodyState
from compas.geometry import Box
from compas.geometry import Frame
from compas_rhino.conversions import plane_to_compas_frame

from compas_fab.robots import RobotCellLibrary
from compas_robots import ToolModel

robot_cell = RobotCell(robot_model, robot_semantics)

# robot_cell.tool_models['Alice'] = ToolModel.from_robot_model(support_robot_model.copy(), Frame.worldXY())
# robot_cell.tool_models['Belle'] = ToolModel.from_robot_model(support_robot_model.copy(), Frame.worldXY())

# robot_cell.tool_models['AL'] = assembly_tool.copy()
# robot_cell.tool_models['AR'] = assembly_tool.copy()

#################
if point_tool:
    robot_cell.tool_models['PointTool'] = point_tool.copy()
if board_tool:
    robot_cell.tool_models['BoardTool'] = board_tool.copy()

#################
robot_cell_state = robot_cell.default_cell_state()

if point_tool:
    robot_cell_state.tool_states['PointTool'].attached_to_group = 'base_left_arm_manipulator'
    robot_cell_state.tool_states['PointTool'].touch_links = ['left_ur_arm_wrist_3_link']

if board_tool:
    robot_cell_state.tool_states['BoardTool'].attached_to_group = 'base_right_arm_manipulator'
    robot_cell_state.tool_states['BoardTool'].touch_links = ['right_ur_arm_wrist_3_link']

# if (rigid_bodies):
#     # Make sure RBs have unique names
#     assert len(set([rb.name for rb in rigid_bodies])) == len(rigid_bodies)
#     for rb in rigid_bodies:
#         assert rb.name
#         robot_cell.rigid_body_models[rb.name] = rb
#         robot_cell_state.rigid_body_states[rb.name] = RigidBodyState(
#             plane_to_compas_frame(object_frame),
#             is_hidden=is_hidden,
#         )

from compas.scene import Scene
scene = Scene()
scene.add(robot_cell)
# ---------- end dual_arm ----------
data = Data(python_3_script_4.robot_cell)

data_2 = Data([-4.87, -0.88, 1.7, -4.39, -1.54, 0])
data_3 = Data([-6, -1.07, 2.07, -2.32, -0.26, 1.32])
data_4 = Data([-5.84, -1, -0.31, 2.82, -1.41, 2.04])
data_5 = Data([-1.79, -3.04, 2.14, 3.32, 0.92, 3.2])
data_6 = Data([0.13, -1.86, -0.57, 0.08, 0.9, 0.04])
panel_6 = Panel(data_6)
panel_7 = Panel(data_2)
panel_8 = Panel(data_3)
panel_9 = Panel(data_5)
panel_10 = Panel(data_4)

data_7 = Data([-0.17, -0.53, -0.77, 0.17, 1.17, -1.47])

visualization_scale = Slider(1, range=0..2)
python_3_script_5 = Python3Script(draw_collision=Toggle(False), draw_visual=Toggle(True), scale=visualization_scale)  # -> out, options; inputs scale: Double
# ---------- python_3_script_5: Python ----------
from compas.data import Data
class RobotCellVisualizationOptions(Data):
    def __init__(self, draw_collision, draw_visual, scale):
        super(RobotCellVisualizationOptions, self).__init__()
        self.draw_collision = draw_collision
        self.draw_visual = draw_visual
        self.native_scale = scale

    @property
    def __data__(self):
        data = {
            'draw_collision': self.draw_collision,
            'draw_visual': self.draw_visual,
            'native_scale': self.native_scale,
            }
        return data

options = RobotCellVisualizationOptions(draw_collision, draw_visual, scale)

print(options.sha256(True))
# ---------- end python_3_script_5 ----------

# ----
# 20260701
# j0
panel_11 = Panel(data_7)

data_8 = Data([0, -3.39, 0.39, -2.31, -1.63, 1.7])
data_9 = Data([0, -3.19, 0.52, -4.51, -0.07, 1.7])
data_10 = Data([0, -3.46, 1.58, -2.62, 0.93, 2.29])
data_11 = Data([0, -2.96, -1.46, -0.39, -1.09, 0])
data_12 = Data([0, -3.15, -0.71, -2.06, -0.09, 1.2])
data_13 = Data([0, -2.91, -1.27, -1.77, -0.67, 1.7])
panel_12 = Panel(data_12)
panel_13 = Panel(data_9)
panel_14 = Panel(data_10)
# j1
panel_15 = Panel(data_11)
panel_16 = Panel(data_13)
panel_17 = Panel(data_8)

# ---- group: left / single arm initial guess
j3 = Slider(2.82, range=-6.28..6.28)
j0 = Slider(-5.84, range=-6.28..6.28)
j1 = Slider(-1, range=-6.28..6.28)
j4 = Slider(-1.41, range=-6.28..6.28)
j5 = Slider(2.04, range=-6.28..6.28)
j2 = Slider(-0.31, range=-3.14..3.14)

# ----
# 5. j0 / j1, which traj
# note: if j1, switch "4. j0" into 0.0, otherwise will have error
target_joint_index = Slider(1, range=0..1)
traj_index = Slider(0, range=0..5)

# ----
# 0. File name and folder dir
panel_18 = Panel("C:\Users\SU\Documents\GitHub\husky-assembly-teleop\data\husky_assembly_design_study\260630_calib_trajs_Belle")
panel_19 = Panel("C:\Users\SU\Documents\GitHub\husky-assembly-teleop\data\husky_assembly_design_study\260630_calib_trajs_Alice")
panel_20 = Panel("D:\0_Project\03-2025_husky_assembly\Code\husky-assembly-teleop\data\husky_assembly_design_study\260108_extrinsic_calib_trajs")
python_3_script_6 = Python3Script(folder_path=panel_19)  # -> out, files
# ---------- python_3_script_6: Python ----------
"""  
Given a folder path, list all files that end with '_RobotCellState.json'.  

Inputs:  
    folder_path: str  - Folder to search in  
Outputs:  
    files: list       - Matching file paths  
"""

import os

files = []
cell_state_path = os.path.join(folder_path, 'RobotCellStates')
# Ensure the folder exists
if not folder_path or not os.path.isdir(cell_state_path):
    print('No path exists')
else:
    for fname in os.listdir(cell_state_path):
        if fname.endswith("_RobotCellState.json"):
            files.append(fname)
# ---------- end python_3_script_6 ----------
format = Format(Format="ext_calib_{2}_J{0}_traj{1}", Culture=127, Data0=target_joint_index, Data1=traj_index, Data2=robot_id)
list_item_2 = ListItem(List=python_3_script_6.files, Index=0, Wrap=False)
concatenate = Concatenate(FragmentA=format, FragmentB="_RobotCellState.json")
panel_21 = Panel(python_3_script_6.files)
panel_22 = Panel(format)
panel_23 = Panel(concatenate)

# ----
# 4-1. j1 range
j1_rotation_range = Slider(1.06, range=0..1.5)

# ---- group: right arm initial guess
number_slider = Slider(-1.5, range=-6.28..6.28)
number_slider_2 = Slider(-3.39, range=-6.28..6.28)
number_slider_3 = Slider(-1.84, range=-3.14..3.14)
number_slider_4 = Slider(-1.32, range=-6.28..6.28)
number_slider_5 = Slider(0.02, range=-6.28..6.28)
number_slider_6 = Slider(0.07, range=-6.28..6.28)

# ---- group: mobile base position
unit_x = UnitX(Factor=1)
unit_y = UnitY(Factor=1)
base_x = Slider(0, range=-2..2)
base_y = Slider(0, range=-2..2)
yaw = Slider(0, range=0..6.283)
rotate = Rotate(Geometry=[unit_x, unit_y], Angle=yaw, Plane=PlaneXY(0, 0, 0))  # -> Geometry, Transform
construct_point = ConstructPoint(XCoordinate=base_x, YCoordinate=base_y, ZCoordinate=0)
list_item_3 = ListItem(List=rotate.Geometry, Index=0, Wrap=True)  # -> Item, Item1
construct_plane = ConstructPlane(Origin=construct_point, XAxis=list_item_3.Item, YAxis=list_item_3.Item1)

# ----
robot_cell = Data(data)
manipulation_group = Data(list_item)
point = Point(Point(0.03967526542, 0.6290765789, 1.215105371))
xy_plane_2 = XYPlane(Origin=point)
panel_24 = Panel("0.001")
vector_xyz = VectorXYZ(XComponent=Slider(0.1, range=-1..1), YComponent=Slider(0.1, range=-1..1), ZComponent=Slider(0.1, range=-1..1))  # -> Vector, Length
curve = Curve(<curve referenced from the Rhino model>)  # disabled
curve_2 = Curve(<curve referenced from the Rhino model>)  # disabled

# ---- group: joint conf initial guess
merge = Merge(Data1=j0, Data2=j1, Data3=j2, Data4=j3, Data5=j4, Data6=j5)

merge_2 = Merge(
    Data1=number_slider,
    Data2=number_slider_2,
    Data3=number_slider_3,
    Data4=number_slider_4,
    Data5=number_slider_5,
    Data6=number_slider_6)

# ----
construct_plane_2 = ConstructPlane(Origin=point, XAxis=curve, YAxis=curve_2)  # disabled
left_stow_pose = Panel("""-87.98
-2.6
-160.61
-108.47
-0.73
90.51""")
move = Move(Geometry=xy_plane_2, Motion=vector_xyz.Vector)  # -> Geometry, Transform
deconstruct_plane = DeconstructPlane(Plane=move.Geometry)  # -> Origin, XAxis, YAxis, ZAxis
radians = Radians(Degrees=left_stow_pose)
radians_2 = Radians(Degrees="180")
number = Number(radians_2)
panel_25 = Panel(number)
solve_ik = BooleanToggle(True)

remove_debug = Button()
disconnect = Button()
python_3_script_7 = Python3Script(x=remove_debug)  # -> remove_all_debug
# ---------- python_3_script_7: Python ----------
import pybullet_planning as pp
pp.remove_all_debug()
# ---------- end python_3_script_7 ----------
python_3_script_8 = Python3Script(trigger=disconnect)  # -> out
# ---------- python_3_script_8: Python ----------
import pybullet_planning as pp
if trigger:
    # client.__exit__()
    pp.disconnect()
# ---------- end python_3_script_8 ----------

# ---- group: loading the client for Cindy
connect_arm = Button()
use_gui = BooleanToggle(False)
robot_cell_2 = Data(data)
python_3_script_9 = Python3Script(trigger=connect_arm, robot_cell=robot_cell_2, use_gui=use_gui)  # -> out, client, planner
# ---------- python_3_script_9: Python ----------
from compas_fab.backends import PyBulletClient
from compas_fab.backends import PyBulletPlanner
import pybullet as p
from scriptcontext import sticky as st
from compas_ghpython import create_id

gh_component = ghenv.Component
sticky_id = create_id(gh_component, '__')
if sticky_id not in st:
    st[sticky_id] = None, None

if trigger:
    client = PyBulletClient(connection_type="gui" if use_gui else "direct", verbose=True)
    client.__enter__()

    # Use PyBullet debug mode by enabling the debug visualizer and optionally adding debug lines/info
    # This will show joint axes, link frames, and other debug info in the GUI
    if use_gui:
        pass
        # p.configureDebugVisualizer(p.COV_ENABLE_GUI, 1, physicsClientId=client.client_id)
        # p.configureDebugVisualizer(p.COV_ENABLE_SHADOWS, 1, physicsClientId=client.client_id)
        # p.configureDebugVisualizer(p.COV_ENABLE_WIREFRAME, 1, physicsClientId=client.client_id)

    planner = PyBulletPlanner(client)
    st[sticky_id] = client, planner

client, planner = st[sticky_id]
if planner is not None:
    planner.set_robot_cell(robot_cell)
# ---------- end python_3_script_9 ----------

# ----
manipulation_group_2 = Data(list_item)
file_name = Data(concatenate)
file_path = Data(panel_19)

# ---- group: parse state
# Example for parsing a cell state
trajectory = Python3Script(file_path=file_path, file_name=file_name)  # -> out, robot_cell_state, trajectory; inputs file_path: String, file_name: String
# ---------- trajectory: Python ----------
import os
from compas import json_load

path = os.path.join(file_path, 'RobotCellStates')
with open(os.path.join(path, file_name), "r") as f:
    robot_cell_state = json_load(f)
print(robot_cell_state.robot_configuration)

traj_file_name = file_name.split('_RobotCellState.json')[0] + '_JointTrajectory.json'
trajectory = json_load(os.path.join(path, traj_file_name))
# ---------- end trajectory ----------

# ----
robot_cell_state = Data(trajectory.robot_cell_state)
python_3_script_10 = Python3Script(cell_state=robot_cell_state, robot_cell=robot_cell, group=manipulation_group)  # -> out, joint_values
# ---------- python_3_script_10: Python ----------
joint_names = robot_cell.get_configurable_joint_names(group)
joint_values = [cell_state.robot_configuration[jn] for jn in joint_names]
# ---------- end python_3_script_10 ----------
pi = Pi(Factor=2)
division = Division(A=pi, B=2)
python_3_script_11 = Python3Script(planner=python_3_script_9.planner)  # -> out, a; disabled
# ---------- python_3_script_11: Python ----------
import pybullet_planning as pp

robot = planner.client.robot_puid
for ln in ['ipad_rack_link', 'top_plate_link']:
    link = pp.link_from_name(robot, ln)
    pp.set_color(robot, pp.RED, link=link)
# ---------- end python_3_script_11 ----------
panel_26 = Panel([trajectory.out, trajectory.trajectory])
multiplication = Multiplication(A=division, B=j1_rotation_range)
degrees = Degrees(Radians=multiplication)
stream_filter = StreamFilter(Gate=target_joint_index, Stream0=pi, Stream1=multiplication)
panel_27 = Panel(degrees)
descent_iters_default_20 = Panel("30")
manipulation_group_3 = Data(list_item)
addition = Addition(A=descent_iters_default_20, B=1)
series = Series(Start="0.0", Step=1, Count=addition)

# ---- group: viz
# 6. Visualization
# note: plan calib traj | on > traj viz step > check if collide
# note: viz full traj | see all the frames
plan_calib_traj = BooleanToggle(True)
traj_viz_step = Slider(30, range=0..31)
viz_full_traj = BooleanToggle(False)
check_collisions = BooleanToggle(False)
viz_saved = BooleanToggle(False)
robot_cell_3 = Data(data)
manipulation_group_4 = Data(list_item)

# ----
check_collisions_bool = Boolean(check_collisions)
plan_calib_traj_bool = Boolean(plan_calib_traj)
viz_saved_bool = Boolean(viz_saved)
gate_or = GateOr(A=plan_calib_traj_bool, B=viz_saved_bool)
check_collisions_bool_2 = Boolean(check_collisions)
plan_calib_traj_bool_2 = Boolean(plan_calib_traj)
viz_saved_bool_2 = Boolean(viz_saved)
viz_saved_bool_3 = Boolean(viz_saved)
list_item_4 = ListItem(List=series, Index=traj_viz_step, Wrap=True)
stream_filter_2 = StreamFilter(Gate=viz_full_traj, Stream0=list_item_4, Stream1=series)
panel_28 = Panel(list_item_4)

# ----
# 7. Save files
save_cell = Button()
save_state = Button()
overwrite = BooleanToggle(True)
robot_cell_4 = Data(data)
file_path_2 = Data(panel_19)
state_name = Data(format)

bake_geometry = BakeGeometry(Bake=save_state, Geometry=<missing>, DeleteOldBakes=False, PreserveTrees=False)

# ----
# 4. modify joints in detail
# note: left/single are controled by upper set, right is bottom
# note: the set should be automatically send(if want to send both, need to be modified)
manipulation_model_numb = Data(manipulation_model_2)
larger_than = LargerThan(FirstNumber=manipulation_model_numb, SecondNumber="1")  # -> LargerThan, OrEqualTo

stream_filter_3 = StreamFilter(Gate=larger_than.LargerThan, Stream0=panel_15, Stream1=merge_2)

merge_3 = Merge(Data1=stream_filter_3)  # disabled
python_3_script_12 = Python3Script(robot_cell_state=python_3_script_4.robot_cell_state, joint_values=stream_filter_3, base_frame=construct_plane)  # -> out, new_robot_cell_state; inputs joint_values: list of Double, base_frame: Plane
# ---------- python_3_script_12: Python ----------
# BUG: this will lose all object data
# new_robot_cell_state = robot_cell_state.copy()

new_robot_cell_state = robot_cell_state.copy()
for i, joint_value in enumerate(joint_values):
    new_robot_cell_state.robot_configuration.joint_values[i] = joint_value

from compas_rhino.conversions import plane_to_compas_frame

new_robot_cell_state.robot_base_frame = plane_to_compas_frame(base_frame)

print(new_robot_cell_state.rigid_body_ids)
# ---------- end python_3_script_12 ----------

python_3_script_13 = Python3Script(
    planner=python_3_script_9.planner,
    manipulation_group=manipulation_group_2,
    robot_cell_state=python_3_script_12.new_robot_cell_state)  # -> out, planner
# ---------- python_3_script_13: Python ----------
import pybullet_planning as pp
from compas.geometry import Frame, Transformation

def pose_from_frame(frame, scale=1.0):
    return ([v*scale for v in frame.point], frame.quaternion.xyzw)

def frame_from_pose(pose, scale=1.0):
    point, (x, y, z, w) = pose
    return Frame.from_quaternion([w, x, y, z], point=[v*scale for v in point])

planner.set_robot_cell_state(robot_cell_state)

# robot_base_frame = robot_cell_state.robot_base_frame
# robot_base_pose = pose_from_frame(robot_base_frame)
# pp.set_pose(planner.client.robot_puid, robot_base_pose)

from compas_fab.robots import TargetMode
import pybullet_planning as pp

pp.draw_pose(pp.unit_pose())

world_from_point_tool = planner.forward_kinematics(robot_cell_state, TargetMode.ROBOT, group=manipulation_group)
pp.draw_pose(pose_from_frame(world_from_point_tool))

# RIGHT_ARM_GROUP = 'base_right_arm_manipulator'
# world_from_board_tool = planner.forward_kinematics(robot_cell_state, TargetMode.ROBOT, group=RIGHT_ARM_GROUP)
# pp.draw_pose(pose_from_frame(world_from_board_tool))
# ---------- end python_3_script_13 ----------

# ---- group: pb backend ik test
python_3_script_14 = Python3Script(
    trigger=plan_calib_traj_bool_2,
    planner=python_3_script_13.planner,
    robot_cell_state=python_3_script_12.new_robot_cell_state,
    group=manipulation_group_3,
    target_joint_index=target_joint_index,
    check_collision=check_collisions_bool_2,
    calib_joint_range=stream_filter,
    steps=descent_iters_default_20)  # -> out, start_state, trajectory; inputs target_joint_index: Int32, calib_joint_range: Double, steps: Int32
# ---------- python_3_script_14: Python ----------
"""
Grasshopper Python component for sampling calibration motion.

This component creates a linear interpolation trajectory in joint space by:
1. Taking a starting cell state
2. Adding calib_joint_range to a nominated joint (0 or 1)
3. Linearly interpolating between start and goal configurations
4. Optionally checking collisions at each point
5. Returning the starting cell state and a JointTrajectory
"""

from compas_fab.backends import PyBulletPlanner
from compas_fab.backends import CollisionCheckError
from compas_fab.robots import RobotCellState
from compas_fab.robots import JointTrajectory
from compas_fab.robots import JointTrajectoryPoint
from compas_fab.robots import Duration


def sample_calib_motion_gh(
    planner,
    robot_cell_state,
    target_joint_index,
    calib_joint_range,
    steps=20,
    check_collision=True,
    group=None
):
    """
    Sample calibration motion by linear interpolation in joint space.
    
    Parameters
    ----------
    planner : PyBulletPlanner
        The planner instance
    robot_cell_state : RobotCellState
        The starting cell state containing the current joint configuration
    target_joint_index : int
        The joint index to calibrate (0 or 1)
    calib_joint_range : float
        The range to add to the target joint (often 2*pi)
    steps : int, optional
        Number of interpolation steps (default: 20)
    check_collision : bool, optional
        Whether to check collisions at each point (default: True)
    group : str, optional
        Planning group name. If None, uses the first configurable group from robot_cell
        
    Returns
    -------
    tuple
        (start_state, trajectory) where:
        - start_state: RobotCellState (copy of input state)
        - trajectory: JointTrajectory containing the interpolated path
        
    Raises
    ------
    ValueError
        If target_joint_index is not 0 or 1
    CollisionCheckError
        If check_collision is True and a collision is detected
    """
    
    # Validate target joint index
    if target_joint_index not in [0, 1]:
        raise ValueError(f"target_joint_index must be 0 or 1, got {target_joint_index}")
    
    # Get planning group
    if group is None:
        # Get the first configurable group from the robot cell
        robot_cell = planner.client.robot_cell
        configurable_groups = robot_cell.get_configurable_groups()
        if not configurable_groups:
            raise ValueError("No configurable groups found in robot_cell")
        group = configurable_groups[0]
        print(f"Using default group: {group}")
    else:
        print(f"Using specified group: {group}")
    
    # Get joint information from the planning group
    robot_cell = planner.client.robot_cell
    joint_names = robot_cell.get_configurable_joint_names(group)
    joint_types = robot_cell.get_configurable_joint_types(group)
    
    # Validate that we have at least target_joint_index + 1 joints
    if len(joint_names) <= target_joint_index:
        raise ValueError(
            f"Planning group '{group}' has only {len(joint_names)} joints, "
            f"but target_joint_index is {target_joint_index}"
        )
    
    print(f"Planning group '{group}' has {len(joint_names)} joints")
    print(f"Joint names: {joint_names}")
    print(f"Target joint index: {target_joint_index} ({joint_names[target_joint_index]})")
    
    # Create a copy of the starting state
    start_state = robot_cell_state.copy()
    
    # Check if the start state is in collision (if collision checking is enabled)
    if check_collision:
        try:
            planner.set_robot_cell_state(start_state)
            options = {"_skip_set_robot_cell_state": True}
            planner.check_collision(start_state, options)
            print("Start state is collision-free")
        except CollisionCheckError as e:
            error_msg = (
                f"The start state is in collision.\n"
                f"  Collision pairs: {e.collision_pairs if hasattr(e, 'collision_pairs') else 'N/A'}\n"
                f"  Error message: {e.message if hasattr(e, 'message') else str(e)}"
            )
            print(f"ERROR: {error_msg}")
            raise CollisionCheckError(error_msg) from e
    
    # Get current joint values from the robot cell state
    start_joint_values = [start_state.robot_configuration[name] for name in joint_names]
    print(f"Start joint values: {start_joint_values}")

    if target_joint_index == 1:
        if abs(start_joint_values[0]) > 1e-8:
            raise ValueError(
                f"target_joint_index==1, but starting configuration for joint '{joint_names[0]}' "
                f"is not zero (value: {start_joint_values[0]})"
            )    
    
    # Create goal configuration by adding calib_joint_range to the target joint
    goal_joint_values = start_joint_values.copy()
    goal_joint_values[target_joint_index] += calib_joint_range
    print(f"Goal joint values: {goal_joint_values}")
    print(f"Joint {target_joint_index} range: {start_joint_values[target_joint_index]:.4f} -> {goal_joint_values[target_joint_index]:.4f} (delta: {calib_joint_range:.4f})")
    
    # Create the JointTrajectory
    trajectory = JointTrajectory(
        joint_names=joint_names,
        start_configuration=start_state.robot_configuration
    )
    
    # Add the start point to the trajectory
    trajectory.points.append(
        JointTrajectoryPoint(
            joint_values=start_joint_values,
            joint_types=joint_types,
            joint_names=joint_names,
            time_from_start=Duration(secs=0, nsecs=0)
        )
    )
    
    # Linearly interpolate between start and goal
    print(f"\nInterpolating {steps} steps between start and goal configurations...")
    
    for j in range(steps):
        # Calculate interpolation factor (0 to 1)
        alpha = (j + 1) / steps
        
        # Linearly interpolate joint values
        interpolated_joint_values = [
            start_val + alpha * (goal_val - start_val)
            for start_val, goal_val in zip(start_joint_values, goal_joint_values)
        ]
        
        # Create a temporary state for collision checking
        if check_collision:
            temp_state = start_state.copy()
            for joint_name, joint_value in zip(joint_names, interpolated_joint_values):
                temp_state.robot_configuration[joint_name] = joint_value
            
            # Check collision at this configuration
            try:
                # Set the robot cell state first
                planner.set_robot_cell_state(temp_state)
                # Then check collision with skip flag to avoid setting state again
                options = {"_skip_set_robot_cell_state": True}
                planner.check_collision(temp_state, options)
            except CollisionCheckError as e:
                error_msg = (
                    f"Collision detected at interpolation step {j+1}/{steps} "
                    f"(alpha={alpha:.4f})\n"
                    f"  Joint values: {interpolated_joint_values}\n"
                    f"  Collision pairs: {e.collision_pairs if hasattr(e, 'collision_pairs') else 'N/A'}\n"
                    f"  Error message: {e.message if hasattr(e, 'message') else str(e)}"
                )
                print(f"ERROR: {error_msg}")
                raise CollisionCheckError(error_msg) from e
        
        # Add the interpolated point to the trajectory
        trajectory.points.append(
            JointTrajectoryPoint(
                joint_values=interpolated_joint_values,
                joint_types=joint_types,
                joint_names=joint_names,
                time_from_start=Duration(secs=(j + 1) * 0.1, nsecs=0)  # 0.1 seconds per step
            )
        )
        
        if (j + 1) % max(1, steps // 5) == 0:  # Print progress every ~20%
            print(f"  Step {j+1}/{steps} completed (alpha={alpha:.4f})")
    
    print(f"\nSuccessfully created trajectory with {len(trajectory.points)} points")
    print(f"  Start: {start_joint_values}")
    print(f"  End: {interpolated_joint_values}")
    
    return start_state, trajectory


# ============================================================================
# Grasshopper component interface
# ============================================================================
# Expected inputs from Grasshopper:
# - planner: PyBulletPlanner instance
# - robot_cell_state: RobotCellState instance
# - target_joint_index: int (0 or 1)
# - calib_joint_range: float (often 2*pi)
# - steps: int (default: 20)
# - check_collision: bool (default: True)
# - group: str (optional, planning group name)
# - trigger: bool (to execute the component)

# Initialize outputs
start_state = None
trajectory = None
error_message = None

if trigger:
    try:
        # Validate inputs
        if planner is None:
            raise ValueError("planner input is required")
        if robot_cell_state is None:
            raise ValueError("robot_cell_state input is required")
        if target_joint_index is None:
            raise ValueError("target_joint_index input is required")
        if calib_joint_range is None:
            raise ValueError("calib_joint_range input is required")
        
        # Set defaults
        if steps is None:
            steps = 20
        if check_collision is None:
            check_collision = True
        
        # Call the main function
        start_state, trajectory = sample_calib_motion_gh(
            planner=planner,
            robot_cell_state=robot_cell_state,
            target_joint_index=target_joint_index,
            calib_joint_range=calib_joint_range,
            steps=steps,
            check_collision=check_collision,
            group=group
        )
        
        print("\n" + "="*60)
        print("CALIBRATION MOTION SAMPLING COMPLETED SUCCESSFULLY")
        print("="*60)
        print(f"Start state: {start_state}")
        print(f"Trajectory points: {len(trajectory.points)}")
        print(f"Joint names: {trajectory.joint_names}")
        
    except Exception as e:
        error_message = str(e)
        print(f"\nERROR in sample_calib_motion_gh: {error_message}")
        import traceback
        traceback.print_exc()
        start_state = None
        trajectory = None
# ---------- end python_3_script_14 ----------

# ----
trajectory_2 = Data(python_3_script_14.trajectory)
start_state = Data(python_3_script_14.start_state)
python_3_script_15 = Python3Script(
    save_robot_cell=save_cell,
    save_state=save_state,
    robot_cell=robot_cell_4,
    robot_cell_state=start_state,
    trajectory=trajectory_2,
    file_path=file_path_2,
    state_name=state_name,
    overwrite=overwrite)  # -> out, a; inputs file_path: String, state_name: String
# ---------- python_3_script_15: Python ----------
# export_robotcell_to_json.py

import json
import os
from datetime import datetime
from compas import json_dump, json_load
from compas_fab.robots import RobotCell, RobotCellState


def export_robotcell_and_state(content, filepath, file_prefix=None, trajectory=None, overwrite=False):
    """
    Export RobotCell or RobotCellState to JSON with optional trajectory data.
    
    Parameters:
    -----------
    content : RobotCell or RobotCellState
        The content to export
    filepath : str
        Directory path where to save the files
    file_prefix : str, optional
        Prefix for the filename
    trajectory : JointTrajectory, optional
        Trajectory to save alongside the state
    overwrite : bool, optional
        If True, overwrite existing files. If False, raise error if file exists.
        Default is False.
        
    Raises:
    -------
    FileExistsError
        If file already exists and overwrite is False
    """
    os.makedirs(filepath, exist_ok=True)  # Ensure directory exists

    content_class = type(content).__name__
    if file_prefix:
        # If this is a RobotCellState, append timestamp for uniqueness
        if isinstance(content, RobotCellState):
            # timestamp = datetime.now().strftime("%Y%m%d_%H%M%S")
            # file_prefix = f"{file_prefix}_{timestamp}"
            pass
        file_name = f"{file_prefix}_{content_class}.json"
    else:
        file_name = f"{content_class}.json"

    full_path = os.path.join(filepath, file_name)
    
    # Check if file exists and overwrite flag is False
    if os.path.exists(full_path) and not overwrite:
        raise FileExistsError(
            f"File '{full_path}' already exists. "
            f"Set overwrite=True to overwrite existing files."
        )

    with open(full_path, "w") as f:
        json_dump(content, f, pretty=True)

    print(f"Exported {content_class} to {full_path}")
    
    # If trajectories are provided and content is RobotCellState, also save the trajectories
    if isinstance(content, RobotCellState):
        if trajectory is not None:
            trajectory_class = type(trajectory).__name__
            if file_prefix:
                trajectory_file_name = f"{file_prefix}_{trajectory_class}.json"
            else:
                trajectory_file_name = f"{trajectory_class}.json"
            
            trajectory_path = os.path.join(filepath, trajectory_file_name)
            
            # Check if trajectory file exists and overwrite flag is False
            if os.path.exists(trajectory_path) and not overwrite:
                raise FileExistsError(
                    f"File '{trajectory_path}' already exists. "
                    f"Set overwrite=True to overwrite existing files."
                )
            
            with open(trajectory_path, "w") as f:
                json_dump(trajectory, f, pretty=True)
            
            print(f"Exported {trajectory_class} to {trajectory_path}")
        

# Example usage:
# robot_cell, robot_cell_state, trajectory = ... (your objects)
if save_robot_cell and robot_cell is not None:
    export_robotcell_and_state(robot_cell, file_path, overwrite=False)
if save_state and robot_cell_state is not None:
    export_robotcell_and_state(
        robot_cell_state,
        os.path.join(file_path, 'RobotCellStates'),
        state_name,
        trajectory,  # Pass trajectory if available
        overwrite=overwrite  # Set to True to allow overwriting
    )
# ---------- end python_3_script_15 ----------
panel_29 = Panel(python_3_script_15.out)

panel_30 = Panel(python_3_script_14.out)
stream_filter_4 = StreamFilter(Gate=viz_saved_bool_3, Stream0=python_3_script_14.trajectory, Stream1=trajectory.trajectory)
stream_filter_5 = StreamFilter(Gate=viz_saved_bool_2, Stream0=python_3_script_14.start_state, Stream1=trajectory.robot_cell_state)
python_3_script_16 = Python3Script(robot_cell_state=stream_filter_5, trajectory=stream_filter_4, step=stream_filter_2)  # -> out, intermediate_robot_cell_state; inputs step: Int32
# ---------- python_3_script_16: Python ----------
import math
intermediate_robot_cell_state = robot_cell_state.copy()  # type: RobotCellState

# step = math.floor(t*(len(trajectory.points)-1))

print("Step: {} - joint_values = {}".format(step, trajectory.points[step].joint_values))
intermediate_robot_cell_state.robot_configuration.merge(trajectory.points[step])
# planner.set_robot_cell_state(intermediate_robot_cell_state)
# ---------- end python_3_script_16 ----------
intermediate_robot_cell_state = Data(python_3_script_16.intermediate_robot_cell_state)
stream_filter_6 = StreamFilter(Gate=gate_or, Stream0=python_3_script_12.new_robot_cell_state, Stream1=intermediate_robot_cell_state)

# ---- group: viz (continued)
python_3_script_17 = Python3Script(
    trigger=python_3_script_4.out,
    planner=python_3_script_13.planner,
    robot_cell=robot_cell_3,
    robot_cell_state=stream_filter_6,
    manipulation_group=manipulation_group_4,
    vis_options=python_3_script_5.options)  # -> out, draw, left_tcp_frame, right_tcp_frame, left_tool0_frame, right_tool0_frame
# ---------- python_3_script_17: Python ----------
#sss vsenv: compas_fab_dev

import scriptcontext as sc
from compas.scene import SceneObject
from compas.scene import Scene
from compas_rhino.conversions import frame_to_rhino_plane
from compas.geometry import Frame, Transformation

from compas_ghpython import create_id

# This script will leak memory due to unused and untracked sceneobject in sticky

debug = True
def debug_print(s):
    if debug:
        print(s)

# Create hash (scope limited to this component) for cacheing SceneObject
# The Data.sha256 function includes the guid of the compas object
#object_hash = object.sha256(as_string=True)
# The ID function is much faster than the sha256()
object_hash = str(id(robot_cell))
options_hash = vis_options.sha256(True)
# The ghenv.Component has a guid assigned by GH to each component instance
gh_component = ghenv.Component
sticky_id = create_id(gh_component, object_hash +"_"+ options_hash)
debug_print("Cacheing ID: '{}'".format(sticky_id))

# If scene object exist in sticky
scene_object = None
if sc.sticky.has_key(sticky_id):
    scene_object = sc.sticky[sticky_id]
    # Double check if the item is the same
    if scene_object.item is robot_cell:
        debug_print("SceneObject '{}' reused for '{}'".format(type(scene_object).__name__, type(object).__name__))

# Create Scene Object
if scene_object is None:
    scene = Scene()
    kwargs = vis_options.__data__
    scene_object = scene.add(robot_cell, **kwargs)
    debug_print("SceneObject {} newly created for {}".format(type(scene_object).__name__, type(object).__name__))
    sc.sticky[sticky_id] = scene_object

# print(scene_object._scale)
draw = scene_object.draw(robot_cell_state)

# world_from_base = Transformation.from_frame(robot_cell_state.robot_base_frame)
# if True:
#     base_from_left_tool0_frame = Transformation.from_frame(
#         robot_cell.robot_model.forward_kinematics(robot_cell_state.robot_configuration, link_name='left_ur_arm_tool0'))
#     left_tool0_frame = frame_to_rhino_plane(Frame.from_transformation(world_from_base * base_from_left_tool0_frame))

#     base_from_right_tool0_frame = Transformation.from_frame(
#         robot_cell.robot_model.forward_kinematics(robot_cell_state.robot_configuration, link_name='right_ur_arm_tool0'))
#     right_tool0_frame = frame_to_rhino_plane(Frame.from_transformation(world_from_base * base_from_right_tool0_frame))
# else:
#     base_from_tool0_frame = Transformation.from_frame(
#         robot_cell.robot_model.forward_kinematics(robot_cell_state.robot_configuration, link_name='ur_arm_tool0'))
#     tool0_frame = frame_to_rhino_plane(Frame.from_transformation(world_from_base * base_from_tool0_frame))

from compas_fab.robots import FrameTarget
from compas_fab.robots import TargetMode

# Check if the internal state is actually None
world_from_point_tool = planner.forward_kinematics(robot_cell_state, TargetMode.ROBOT, group=manipulation_group)
left_tcp_frame = frame_to_rhino_plane(world_from_point_tool)
# world_from_board_tool = planner.forward_kinematics(robot_cell_state, TargetMode.TOOL, group=RIGHT_ARM_GROUP)
# right_tcp_frame = frame_to_rhino_plane(world_from_board_tool)

world_from_left_tool0 = planner.forward_kinematics(robot_cell_state, TargetMode.ROBOT, group=manipulation_group)
left_tool0_frame = frame_to_rhino_plane(world_from_left_tool0)
# world_from_right_tool0 = planner.forward_kinematics(robot_cell_state, TargetMode.ROBOT, group=RIGHT_ARM_GROUP)
# right_tool0_frame = frame_to_rhino_plane(world_from_right_tool0)

# ee_link_name = robot_cell.get_end_effector_link_name(group=LEFT_ARM_GROUP)
# print("Frame of the T0CF (name='{}') in World Coordinate Frame:".format(ee_link_name))
# ---------- end python_3_script_17 ----------
mesh = Mesh(python_3_script_17.draw)
draw = GhPythonScript(planes=[python_3_script_17.left_tcp_frame, python_3_script_17.right_tcp_frame], scale=Slider(0.015, range=0..1))  # -> P, V, C, W; inputs planes: list
# ---------- draw: Python ----------
from System.Drawing import Color

red = Color.FromArgb(255, 0, 0)
green = Color.FromArgb(0, 255, 0)
blue = Color.FromArgb(0, 0, 255)

P = []
V = []
C = []

scale = float(scale)

for plane in planes:
    if not plane:
        continue
    P += [plane.Origin] * 3
    V.append(plane.XAxis * scale)
    V.append(plane.YAxis * scale)
    V.append(plane.ZAxis * scale)
    C += [red, green, blue]

W = 3
# ---------- end draw ----------
group = Group(Geometry=draw.P)
vdisex = VectorDisplayEx(Point=draw.P, Vector=draw.V, Colour=draw.C, Width=draw.W)
data_14 = Data(group)

# ----
# 3. roughly move the TCP frame with sliders
# note: check the index, should match to the robot you are using
get_groups = GetGroups()  # -> Groups, GroupStyles, Nickname, Color
list_item_5 = ListItem(List=get_groups.Groups, Index="14", Wrap=True)
panel_31 = Panel(get_groups.Nickname)
get_objects_in_group = GetObjectsInGroup(Group=list_item_5)
panel_32 = Panel("0.0")
multiplication_2 = Multiplication(A=deconstruct_plane.XAxis, B=Slider(0.308, range=-0.5..0.5))
multiplication_3 = Multiplication(A=deconstruct_plane.YAxis, B=Slider(-0.078, range=-1..1))
multiplication_4 = Multiplication(A=deconstruct_plane.ZAxis, B=Slider(-0.285, range=-1..1))
addition_2 = Addition(A=multiplication_2, B=multiplication_3, C=multiplication_4)

move_2 = Move(Geometry=move.Geometry, Motion=addition_2)  # -> Geometry, Transform
deconstruct_plane_2 = DeconstructPlane(Plane=move_2.Geometry)  # -> Origin, XAxis, YAxis, ZAxis
rotate_3d = Rotate3D(
    Geometry=move_2.Geometry,
    Angle=degrees(Slider(-105, range=-180..180)),
    Center=deconstruct_plane_2.Origin,
    Axis=deconstruct_plane_2.XAxis)  # -> Geometry, Transform
plane = Plane(rotate_3d.Geometry)
python_3_script_18 = Python3Script(
    trigger=solve_ik,
    planner=python_3_script_13.planner,
    robot_cell_state=python_3_script_12.new_robot_cell_state,
    target_planes=plane,
    groups=list_item,
    check_collision=check_collisions_bool,
    tolerance_position="0.0001",
    tolerance_orientation="0.0001",
    max_descend_iterations="30")  # -> out, joint_values, new_robot_cell_state; inputs target_planes: list of Plane, groups: list, tolerance_position: Double, tolerance_orientation: Double, max_descend_iterations: Int32
# ---------- python_3_script_18: Python ----------
from compas.geometry import Frame

from compas_fab.backends import PyBulletClient
from compas_fab.backends import PyBulletPlanner
from compas_fab.robots import FrameTarget
from compas_fab.robots import RobotCellLibrary
from compas_fab.robots import TargetMode
from compas_rhino.conversions import plane_to_compas_frame
import pybullet_planning as pp
import pybullet as p

from compas.geometry import Frame, Transformation

def pose_from_frame(frame, scale=1.0):
    return ([v*scale for v in frame.point], frame.quaternion.xyzw)

def frame_from_pose(pose, scale=1.0):
    point, (x, y, z, w) = pose
    return Frame.from_quaternion([w, x, y, z], point=[v*scale for v in point])

targets = []
for tp in target_planes:    
    target = FrameTarget(plane_to_compas_frame(tp), 
                         TargetMode.ROBOT,
                         tolerance_position=tolerance_position,
                         tolerance_orientation=tolerance_orientation
                         )
    targets.append(target)
    pp.draw_pose(pose_from_frame(target.target_frame))

new_robot_cell_state = None
        
if trigger:
    print(planner.client._get_pose_joint_names_and_puids())

    options = {
        "max_results": 20, 
        "check_collision": check_collision,
        "max_descend_iterations" : max_descend_iterations,
        "verbose" : False,
        }

    new_robot_cell_state = robot_cell_state.copy()
    for target, group in zip(targets, groups):
        print(f'ik for {group}')
        try:
        # if 1:
            config = planner.inverse_kinematics(
                target, 
                new_robot_cell_state, 
                group=group, 
                options=options
            )
        except Exception as e:
            print(f"IK failed for {group}: {e}")
            config = None

        if config is not None:
                # To verify the IK result, we can compute the FK with the obtained joint positions
            print(config)
            new_robot_cell_state.robot_configuration.merge(config)

            # # Only update the joints in this group
            # group_joint_names = planner.client.robot_cell.get_configurable_joint_names(group)
            # for joint_name, joint_value in zip(config.joint_names, config.joint_values):
            #     if joint_name in group_joint_names:
            #         new_robot_cell_state.robot_configuration[joint_name] = joint_value

if new_robot_cell_state:
    joint_values = list(config.joint_values)
    planner.client._set_robot_configuration(new_robot_cell_state.robot_configuration)


print("Found configuration", config)
# result_count += 1
# print("Found %d configurations" % result_count)
# ---------- end python_3_script_18 ----------

set_slider_properties = SetSliderProperties(Slider=flatten(get_objects_in_group), Value=python_3_script_18.joint_values)  # disabled

panel_33 = Panel(python_3_script_18.out)
